# Grasshopper definition CR_VS-UMCF_J-DOE01to08.gh (Grasshopper 1.0.8)
# plug-ins: RhinoCodePluginGH, UMCF

number_slider = Slider(0.32, range=0..1)
number_slider_2 = Slider(0.32, range=0..1)
number_slider_3 = Slider(0.32, range=0..1)
custom_mesh_settings = SettingsCustom(
    StitchSeams=True,
    SimplePlanes=False,
    Refine=True,
    MinCount=16,
    MaxCount=400,
    AspectRatio=20,
    MaxDistance=0,
    MaxAngle=20,
    MinEdge=number_slider,
    MaxEdge=number_slider)
custom_mesh_settings_2 = SettingsCustom(
    StitchSeams=True,
    SimplePlanes=False,
    Refine=True,
    MinCount=16,
    MaxCount=400,
    AspectRatio=20,
    MaxDistance=0,
    MaxAngle=20,
    MinEdge=number_slider_2,
    MaxEdge=number_slider_2)
custom_mesh_settings_3 = SettingsCustom(
    StitchSeams=True,
    SimplePlanes=False,
    Refine=True,
    MinCount=16,
    MaxCount=400,
    AspectRatio=20,
    MaxDistance=0,
    MaxAngle=20,
    MinEdge=number_slider_3,
    MaxEdge=number_slider_3)
# Setup
number_slider_4 = Slider(10, range=0..10)
# Setup
number_slider_5 = Slider(10, range=0..10)
# Setup
number_slider_6 = Slider(10, range=0..10)

# ---- group: Building
brep = Brep([<brep referenced from the Rhino model> x2])

# ----
brep_2 = Brep([<brep referenced from the Rhino model> x2])
brep_3 = Brep([<brep referenced from the Rhino model> x2])
brep_4 = Brep([<brep referenced from the Rhino model> x2])

# ---- group: Vegetation
brep_5 = Brep([<brep referenced from the Rhino model> x3])

# ----
# Setup
number_slider_7 = Slider(0.32, range=0..1)
custom_mesh_settings_4 = SettingsCustom(
    StitchSeams=True,
    SimplePlanes=False,
    Refine=True,
    MinCount=16,
    MaxCount=400,
    AspectRatio=20,
    MaxDistance=0,
    MaxAngle=20,
    MinEdge=number_slider_7,
    MaxEdge=number_slider_7)
number_slider_8 = Slider(0, range=0..100)
number_slider_9 = Slider(8.2, range=0..100)
number_slider_10 = Slider(11, range=0..100)
number_slider_11 = Slider(4.7, range=0..100)
number_slider_12 = Slider(14, range=0..100)
number_slider_13 = Slider(3.4, range=0..100)
X = UnitX(Factor=1)
rotate = Rotate(Geometry=X, Angle=degrees(Slider(0, range=0..100)), Plane=PlaneXY(0, 0, 0))  # -> Geometry, Transform
mesh = MeshBrep(Brep=brep, Settings=custom_mesh_settings_4)
vegproperties = VegetationProperties(
    H=Slider(3, range=0..15),
    L=Slider(0.05, range=0..0.15),
    RsMin=Slider(400, range=0..10000),
    NEvapSides=Slider(1, range=0..1))
mesh_2 = MeshBrep(Brep=brep_5, Settings=custom_mesh_settings_4)
abl = ABLCondition(WindSpeed=Slider(10, range=0..10), Height=Slider(10, range=0..10), WindDirection=rotate.Geometry)
boxdomaindim = BoxDomainDimensions(
    CellSize=Slider(15, range=0..100),
    FrontAdd=Slider(0, range=0..100),
    BackAdd=Slider(0, range=0..100),
    SidesAdd=Slider(0, range=0..100),
    TopAdd=Slider(0, range=0..100),
    RefinementBoxAdd=Slider(15, range=0..100))
brick = BuildingMaterialHamstad5Brick()
mesh_3 = Mesh([<mesh referenced from the Rhino model> x3])
mesh_4 = Mesh([<mesh referenced from the Rhino model> x4])
airregion = AirRegion(ABLConditionSetting=abl, BoxDomainParameters=boxdomaindim)
vegregion = VegetationRegion(VegetationMesh=mesh_4, LAD=Slider(1.5, range=0..5), VegetationProperties=vegproperties)
solidregion = SolidRegion(SolidRegionName="Building", Mesh=mesh, Material=brick, BuildingTemperature=Slider(16, range=0..100))

brep_6 = Brep([<brep referenced from the Rhino model> x3])
brep_7 = Brep([<brep referenced from the Rhino model> x3])
number_slider_14 = Slider(0, range=0..100)
number_slider_15 = Slider(0, range=0..100)
brep_8 = Brep([<brep referenced from the Rhino model> x3])
number_slider_16 = Slider(0, range=0..100)
number_slider_17 = Slider(8.2, range=0..100)
number_slider_18 = Slider(11, range=0..100)
number_slider_19 = Slider(4.7, range=0..100)
number_slider_20 = Slider(8.2, range=0..100)
number_slider_21 = Slider(11, range=0..100)
number_slider_22 = Slider(4.7, range=0..100)
number_slider_23 = Slider(14, range=0..100)
number_slider_24 = Slider(3.4, range=0..100)
number_slider_25 = Slider(14, range=0..100)
number_slider_26 = Slider(3.4, range=0..100)
number_slider_27 = Slider(8.2, range=0..100)
number_slider_28 = Slider(11, range=0..100)
number_slider_29 = Slider(4.7, range=0..100)
number_slider_30 = Slider(14, range=0..100)
number_slider_31 = Slider(3.4, range=0..100)
X_2 = UnitX(Factor=1)
X_3 = UnitX(Factor=1)
X_4 = UnitX(Factor=1)
rotate_2 = Rotate(Geometry=X_2, Angle=degrees(Slider(0, range=0..100)), Plane=PlaneXY(0, 0, 0))  # -> Geometry, Transform
rotate_3 = Rotate(Geometry=X_3, Angle=degrees(Slider(0, range=0..100)), Plane=PlaneXY(0, 0, 0))  # -> Geometry, Transform
mesh_5 = MeshBrep(Brep=brep_2, Settings=custom_mesh_settings)
mesh_6 = MeshBrep(Brep=brep_3, Settings=custom_mesh_settings_2)
rotate_4 = Rotate(Geometry=X_4, Angle=degrees(Slider(0, range=0..100)), Plane=PlaneXY(0, 0, 0))  # -> Geometry, Transform
mesh_7 = MeshBrep(Brep=brep_4, Settings=custom_mesh_settings_3)
vegproperties_2 = VegetationProperties(
    H=Slider(3, range=0..15),
    L=Slider(0.05, range=0..0.15),
    RsMin=Slider(400, range=0..10000),
    NEvapSides=Slider(1, range=0..1))
vegproperties_3 = VegetationProperties(
    H=Slider(3, range=0..15),
    L=Slider(0.05, range=0..0.15),
    RsMin=Slider(400, range=0..10000),
    NEvapSides=Slider(1, range=0..1))
vegproperties_4 = VegetationProperties(
    H=Slider(3, range=0..15),
    L=Slider(0.05, range=0..0.15),
    RsMin=Slider(400, range=0..10000),
    NEvapSides=Slider(1, range=0..1))
mesh_8 = MeshBrep(Brep=brep_6, Settings=custom_mesh_settings)
mesh_9 = MeshBrep(Brep=brep_7, Settings=custom_mesh_settings_2)
mesh_10 = MeshBrep(Brep=brep_8, Settings=custom_mesh_settings_3)
abl_2 = ABLCondition(WindSpeed=number_slider_4, Height=Slider(10, range=0..10), WindDirection=rotate_2.Geometry)
abl_3 = ABLCondition(WindSpeed=number_slider_5, Height=Slider(10, range=0..10), WindDirection=rotate_3.Geometry)
abl_4 = ABLCondition(WindSpeed=number_slider_6, Height=Slider(10, range=0..10), WindDirection=rotate_4.Geometry)
boxdomaindim_2 = BoxDomainDimensions(
    CellSize=Slider(15, range=0..100),
    FrontAdd=Slider(0, range=0..100),
    BackAdd=Slider(0, range=0..100),
    SidesAdd=Slider(0, range=0..100),
    TopAdd=Slider(0, range=0..100),
    RefinementBoxAdd=Slider(15, range=0..100))
boxdomaindim_3 = BoxDomainDimensions(
    CellSize=Slider(15, range=0..100),
    FrontAdd=Slider(0, range=0..100),
    BackAdd=Slider(0, range=0..100),
    SidesAdd=Slider(0, range=0..100),
    TopAdd=Slider(0, range=0..100),
    RefinementBoxAdd=Slider(15, range=0..100))
boxdomaindim_4 = BoxDomainDimensions(
    CellSize=Slider(15, range=0..100),
    FrontAdd=Slider(0, range=0..100),
    BackAdd=Slider(0, range=0..100),
    SidesAdd=Slider(0, range=0..100),
    TopAdd=Slider(0, range=0..100),
    RefinementBoxAdd=Slider(15, range=0..100))
brick_2 = BuildingMaterialHamstad5Brick()
brick_3 = BuildingMaterialHamstad5Brick()
mesh_11 = Mesh([<mesh referenced from the Rhino model> x3])
mesh_12 = Mesh([<mesh referenced from the Rhino model> x4])
mesh_13 = Mesh([<mesh referenced from the Rhino model> x3])
mesh_14 = Mesh([<mesh referenced from the Rhino model> x4])
brick_4 = BuildingMaterialHamstad5Brick()
mesh_15 = Mesh([<mesh referenced from the Rhino model> x3])
mesh_16 = Mesh([<mesh referenced from the Rhino model> x4])
airregion_2 = AirRegion(ABLConditionSetting=abl_2, BoxDomainParameters=boxdomaindim_2)
airregion_3 = AirRegion(ABLConditionSetting=abl_3, BoxDomainParameters=boxdomaindim_3)
vegregion_2 = VegetationRegion(VegetationMesh=mesh_12, LAD=Slider(1.5, range=0..5), VegetationProperties=vegproperties_2)
vegregion_3 = VegetationRegion(VegetationMesh=mesh_14, LAD=Slider(1.5, range=0..5), VegetationProperties=vegproperties_3)
solidregion_2 = SolidRegion(SolidRegionName="Building", Mesh=mesh_5, Material=brick_2, BuildingTemperature=Slider(16, range=0..100))
solidregion_3 = SolidRegion(SolidRegionName="Building", Mesh=mesh_6, Material=brick_3, BuildingTemperature=Slider(16, range=0..100))
airregion_4 = AirRegion(ABLConditionSetting=abl_4, BoxDomainParameters=boxdomaindim_4)
vegregion_4 = VegetationRegion(VegetationMesh=mesh_16, LAD=Slider(1.5, range=0..5), VegetationProperties=vegproperties_4)
solidregion_4 = SolidRegion(SolidRegionName="Building", Mesh=mesh_7, Material=brick_4, BuildingTemperature=Slider(16, range=0..100))
path = FilePath("C:\Users\crothe3\GaTech Dropbox\Chinmay Rothe\UMCF\CR_Vegetation Siulation files\USA_GA_Atlanta-Hartsfield-Jackson.Intl.AP.722190_TMYx\USA_GA_Atlanta-Hartsfield-Jackson.Intl.AP.722190_TMYx.epw")
duration = Slider(5, range=0..24)
path_2 = FilePath("C:\Users\crothe3\GaTech Dropbox\Chinmay Rothe\UMCF\CR_Vegetation Siulation files\USA_GA_Atlanta-Hartsfield-Jackson.Intl.AP.722190_TMYx\USA_GA_Atlanta-Hartsfield-Jackson.Intl.AP.722190_TMYx.epw")
duration_2 = Slider(5, range=0..24)
path_3 = FilePath("C:\Users\crothe3\GaTech Dropbox\Chinmay Rothe\UMCF\CR_Vegetation Siulation files\USA_GA_Atlanta-Hartsfield-Jackson.Intl.AP.722190_TMYx\USA_GA_Atlanta-Hartsfield-Jackson.Intl.AP.722190_TMYx.epw")
duration_3 = Slider(5, range=0..24)
path_4 = FilePath("C:\Users\crothe3\GaTech Dropbox\Chinmay Rothe\UMCF\CR_Vegetation Siulation files\USA_GA_Atlanta-Hartsfield-Jackson.Intl.AP.722190_TMYx\USA_GA_Atlanta-Hartsfield-Jackson.Intl.AP.722190_TMYx.epw")
duration_4 = Slider(5, range=0..24)
weather = Weather(EPWFilePath=path)
weather_2 = Weather(EPWFilePath=path_2)
weather_3 = Weather(EPWFilePath=path_3)
weather_4 = Weather(EPWFilePath=path_4)
timing = TimingParameters(Weather=weather, StartDay=Slider(171, range=0..364), StartTime=Slider(11, range=0..23), Duration=duration)
timing_2 = TimingParameters(Weather=weather_2, StartDay=Slider(171, range=0..364), StartTime=Slider(11, range=0..23), Duration=duration_2)
timing_3 = TimingParameters(Weather=weather_3, StartDay=Slider(171, range=0..364), StartTime=Slider(11, range=0..23), Duration=duration_3)
timing_4 = TimingParameters(Weather=weather_4, StartDay=Slider(171, range=0..364), StartTime=Slider(11, range=0..23), Duration=duration_4)
simsettings = SimulationSettings(NumberOfCPUs=Slider(12, range=0..20), MaxFluidIteration=Slider(100, range=0..1000))
simsettings_2 = SimulationSettings(NumberOfCPUs=Slider(12, range=0..20), MaxFluidIteration=Slider(100, range=0..1000))
simsettings_3 = SimulationSettings(NumberOfCPUs=Slider(12, range=0..20), MaxFluidIteration=Slider(100, range=0..1000))
simsettings_4 = SimulationSettings(NumberOfCPUs=Slider(12, range=0..20), MaxFluidIteration=Slider(100, range=0..1000))
desetting = DeconstructSetting(Setting=timing)  # -> Entries, ListContainers
desetting_2 = DeconstructSetting(Setting=timing_2)  # -> Entries, ListContainers
desetting_3 = DeconstructSetting(Setting=timing_3)  # -> Entries, ListContainers
desetting_4 = DeconstructSetting(Setting=timing_4)  # -> Entries, ListContainers
write = Button()
write_2 = Button()
write_3 = Button()
clear = Button()
clear_2 = Button()
clear_3 = Button()
write_4 = Button()
clear_4 = Button()
path_5 = FilePath("C:\MetaFoam_Cases\")
path_6 = FilePath("C:\MetaFoam_Cases\")
path_7 = FilePath("C:\MetaFoam_Cases\")
path_8 = FilePath("C:\MetaFoam_Cases\")
item = ListItem(List=desetting.ListContainers, Index=Slider(4, range=0..10), Wrap=True)
item_2 = ListItem(List=desetting_2.ListContainers, Index=Slider(4, range=0..10), Wrap=True)
item_3 = ListItem(List=desetting_3.ListContainers, Index=Slider(4, range=0..10), Wrap=True)
item_4 = ListItem(List=desetting_4.ListContainers, Index=Slider(4, range=0..10), Wrap=True)
umcf_case = UrbabMicroClimateFoamCase(
    WriteCase=write,
    ClearCase=clear,
    NewCaseName="CR_VS-UMCF_J-DOE09d",
    WorkingDirectory=path_5,
    AirRegion=airregion,
    VegetationRegions=vegregion,
    SolidRegions=solidregion,
    TimingSettings=timing,
    SimulationSettings=simsettings)  # -> ModificationLogs, Case, DomainBox, RefinementBox
umcf_case_2 = UrbabMicroClimateFoamCase(
    WriteCase=write_2,
    ClearCase=clear_2,
    NewCaseName="CR_VS-UMCF_J-DOE09d",
    WorkingDirectory=path_6,
    AirRegion=airregion_2,
    VegetationRegions=vegregion_2,
    SolidRegions=solidregion_2,
    TimingSettings=timing_2,
    SimulationSettings=simsettings_2)  # -> ModificationLogs, Case, DomainBox, RefinementBox
umcf_case_3 = UrbabMicroClimateFoamCase(
    WriteCase=write_3,
    ClearCase=clear_3,
    NewCaseName="CR_VS-UMCF_J-DOE09d",
    WorkingDirectory=path_7,
    AirRegion=airregion_3,
    VegetationRegions=vegregion_3,
    SolidRegions=solidregion_3,
    TimingSettings=timing_3,
    SimulationSettings=simsettings_3)  # -> ModificationLogs, Case, DomainBox, RefinementBox
umcf_case_4 = UrbabMicroClimateFoamCase(
    WriteCase=write_4,
    ClearCase=clear_4,
    NewCaseName="CR_VS-UMCF_J-DOE09d",
    WorkingDirectory=path_8,
    AirRegion=airregion_4,
    VegetationRegions=vegregion_4,
    SolidRegions=solidregion_4,
    TimingSettings=timing_4,
    SimulationSettings=simsettings_4)  # -> ModificationLogs, Case, DomainBox, RefinementBox
defilecontainer = DeconstructFileContainer(FileContainer=item)  # -> Name, FileType, Keys, Values, RawContent, TotalRawContent
defilecontainer_2 = DeconstructFileContainer(FileContainer=item_2)  # -> Name, FileType, Keys, Values, RawContent, TotalRawContent
defilecontainer_3 = DeconstructFileContainer(FileContainer=item_3)  # -> Name, FileType, Keys, Values, RawContent, TotalRawContent
defilecontainer_4 = DeconstructFileContainer(FileContainer=item_4)  # -> Name, FileType, Keys, Values, RawContent, TotalRawContent
panel = Panel(defilecontainer.Name)
panel_2 = Panel(defilecontainer_2.Name)
panel_3 = Panel(defilecontainer_3.Name)
panel_4 = Panel(defilecontainer.RawContent)
rep = ReplaceText(Text=defilecontainer.Values, Find="(", RecursiveReplace=False)
panel_5 = Panel(defilecontainer_2.RawContent)
rep_2 = ReplaceText(Text=defilecontainer_2.Values, Find="(", RecursiveReplace=False)
panel_6 = Panel(defilecontainer_3.RawContent)
rep_3 = ReplaceText(Text=defilecontainer_3.Values, Find="(", RecursiveReplace=False)
panel_7 = Panel(defilecontainer_4.Name)
panel_8 = Panel(defilecontainer_4.RawContent)
rep_4 = ReplaceText(Text=defilecontainer_4.Values, Find="(", RecursiveReplace=False)
wires = BrepWireframe(Brep=umcf_case.DomainBox, Density=-1)
wires_2 = BrepWireframe(Brep=umcf_case_2.DomainBox, Density=-1)
wires_3 = BrepWireframe(Brep=umcf_case_3.DomainBox, Density=-1)
wires_4 = BrepWireframe(Brep=umcf_case_4.DomainBox, Density=-1)
wires_5 = BrepWireframe(Brep=umcf_case.RefinementBox, Density=-1)
wires_6 = BrepWireframe(Brep=umcf_case_2.RefinementBox, Density=-1)
wires_7 = BrepWireframe(Brep=umcf_case_3.RefinementBox, Density=-1)
wires_8 = BrepWireframe(Brep=umcf_case_4.RefinementBox, Density=-1)
panel_9 = Panel(umcf_case.ModificationLogs)
panel_10 = Panel(umcf_case_2.ModificationLogs)
panel_11 = Panel(umcf_case_3.ModificationLogs)
rep_5 = ReplaceText(Text=rep, Find=")", RecursiveReplace=False)
rep_6 = ReplaceText(Text=rep_2, Find=")", RecursiveReplace=False)
rep_7 = ReplaceText(Text=rep_3, Find=")", RecursiveReplace=False)
panel_12 = Panel(umcf_case_4.ModificationLogs)
rep_8 = ReplaceText(Text=rep_4, Find=")", RecursiveReplace=False)
preview = CustomPreview(Geometry=wires, Material=ColourSwatch(SwatchColor=RGB(97, 97, 97)))
preview_2 = CustomPreview(Geometry=wires_2, Material=ColourSwatch(SwatchColor=RGB(97, 97, 97)))
preview_3 = CustomPreview(Geometry=wires_3, Material=ColourSwatch(SwatchColor=RGB(97, 97, 97)))
preview_4 = CustomPreview(Geometry=wires_5, Material=ColourSwatch(SwatchColor=RGB(230, 230, 230)))
preview_5 = CustomPreview(Geometry=wires_6, Material=ColourSwatch(SwatchColor=RGB(230, 230, 230)))
preview_6 = CustomPreview(Geometry=wires_7, Material=ColourSwatch(SwatchColor=RGB(230, 230, 230)))
preview_7 = CustomPreview(Geometry=wires_4, Material=ColourSwatch(SwatchColor=RGB(97, 97, 97)))
preview_8 = CustomPreview(Geometry=wires_8, Material=ColourSwatch(SwatchColor=RGB(230, 230, 230)))
split = TextSplit(Text=rep_5, Separators=" ")  # disabled
split_2 = TextSplit(Text=rep_6, Separators=" ")  # disabled
split_3 = TextSplit(Text=rep_7, Separators=" ")  # disabled
split_4 = TextSplit(Text=rep_8, Separators=" ")  # disabled
caserun = CaseRun(
    Case=umcf_case.Case,
    PrepareSimulation=Button(),
    PrepareSimulationInParallel=Button(),
    RunSimulation=Button(),
    RunSimulationInParallel=Button())  # -> Case, LogFileNames, LogFileContent
caserun_2 = CaseRun(
    Case=umcf_case_2.Case,
    PrepareSimulation=Button(),
    PrepareSimulationInParallel=Button(),
    RunSimulation=Button(),
    RunSimulationInParallel=Button())  # -> Case, LogFileNames, LogFileContent
caserun_3 = CaseRun(
    Case=umcf_case_3.Case,
    PrepareSimulation=Button(),
    PrepareSimulationInParallel=Button(),
    RunSimulation=Button(),
    RunSimulationInParallel=Button())  # -> Case, LogFileNames, LogFileContent
caserun_4 = CaseRun(
    Case=umcf_case_4.Case,
    PrepareSimulation=Button(),
    PrepareSimulationInParallel=Button(),
    RunSimulation=Button(),
    RunSimulationInParallel=Button())  # -> Case, LogFileNames, LogFileContent
item_5 = ListItem(List=split, Index=0, Wrap=True)  # -> Item, Item1, Item2; disabled
item_6 = ListItem(List=split_2, Index=0, Wrap=True)  # -> Item, Item1, Item2; disabled
item_7 = ListItem(List=split_3, Index=0, Wrap=True)  # -> Item, Item1, Item2; disabled
item_8 = ListItem(List=split_4, Index=0, Wrap=True)  # -> Item, Item1, Item2; disabled
debrep = DeconstructBrep(Brep=umcf_case.DomainBox)  # -> Faces, Edges, Vertices
debrep_2 = DeconstructBrep(Brep=umcf_case_2.DomainBox)  # -> Faces, Edges, Vertices
debrep_3 = DeconstructBrep(Brep=umcf_case_3.DomainBox)  # -> Faces, Edges, Vertices
debrep_4 = DeconstructBrep(Brep=umcf_case_4.DomainBox)  # -> Faces, Edges, Vertices
pt = ConstructPoint(XCoordinate=item_5.Item, YCoordinate=item_5.Item1, ZCoordinate=item_5.Item2)  # disabled
pt_2 = ConstructPoint(XCoordinate=item_6.Item, YCoordinate=item_6.Item1, ZCoordinate=item_6.Item2)  # disabled
pt_3 = ConstructPoint(XCoordinate=item_7.Item, YCoordinate=item_7.Item1, ZCoordinate=item_7.Item2)  # disabled
pt_4 = ConstructPoint(XCoordinate=item_8.Item, YCoordinate=item_8.Item1, ZCoordinate=item_8.Item2)  # disabled
item_9 = ListItem(List=debrep.Faces, Index=Slider(4, range=0..10), Wrap=True)
item_10 = ListItem(List=debrep_2.Faces, Index=Slider(4, range=0..10), Wrap=True)
item_11 = ListItem(List=debrep_3.Faces, Index=Slider(4, range=0..10), Wrap=True)
item_12 = ListItem(List=debrep_4.Faces, Index=Slider(4, range=0..10), Wrap=True)
panel_13 = Panel(defilecontainer.Values)
panel_14 = Panel(defilecontainer_2.Values)
panel_15 = Panel(defilecontainer_3.Values)
panel_16 = Panel(defilecontainer_4.Values)
crv = Curve(item_9)
crv_2 = Curve(item_10)
crv_3 = Curve(item_11)
crv_4 = Curve(item_12)
mesh_uv = MeshSurface(Surface=item_9, UCount=Slider(49, range=0..100), VCount=Slider(31, range=0..100), Overhang=True, Equalize=False)
mesh_uv_2 = MeshSurface(Surface=item_10, UCount=Slider(49, range=0..100), VCount=Slider(31, range=0..100), Overhang=True, Equalize=False)
mesh_uv_3 = MeshSurface(Surface=item_11, UCount=Slider(49, range=0..100), VCount=Slider(31, range=0..100), Overhang=True, Equalize=False)
cap = CapHoles(Brep=brep)
cap_2 = CapHoles(Brep=brep_2)
cap_3 = CapHoles(Brep=brep_3)
mesh_uv_4 = MeshSurface(Surface=item_12, UCount=Slider(49, range=0..100), VCount=Slider(31, range=0..100), Overhang=True, Equalize=False)
cap_4 = CapHoles(Brep=brep_4)
Z = UnitZ(Factor=Slider(2, range=0..10))
Z_2 = UnitZ(Factor=Slider(2, range=0..10))
Z_3 = UnitZ(Factor=Slider(2, range=0..10))
Z_4 = UnitZ(Factor=Slider(2, range=0..10))
preview_9 = CustomPreview(Geometry=crv, Material=ColourSwatch(SwatchColor=RGB(0, 0, 0)))
preview_10 = CustomPreview(Geometry=crv_2, Material=ColourSwatch(SwatchColor=RGB(0, 0, 0)))
preview_11 = CustomPreview(Geometry=crv_3, Material=ColourSwatch(SwatchColor=RGB(0, 0, 0)))
preview_12 = CustomPreview(Geometry=crv_4, Material=ColourSwatch(SwatchColor=RGB(0, 0, 0)))
move = Move(Geometry=mesh_uv, Motion=Z)  # -> Geometry, Transform
move_2 = Move(Geometry=mesh_uv_2, Motion=Z_2)  # -> Geometry, Transform
move_3 = Move(Geometry=mesh_uv_3, Motion=Z_3)  # -> Geometry, Transform
move_4 = Move(Geometry=mesh_uv_4, Motion=Z_4)  # -> Geometry, Transform
demesh = DeconstructMesh(Mesh=move.Geometry)  # -> Vertices, Faces, Colours, Normals
demesh_2 = DeconstructMesh(Mesh=move_2.Geometry)  # -> Vertices, Faces, Colours, Normals
demesh_3 = DeconstructMesh(Mesh=move_3.Geometry)  # -> Vertices, Faces, Colours, Normals
demesh_4 = DeconstructMesh(Mesh=move_4.Geometry)  # -> Vertices, Faces, Colours, Normals
brepsinc = PointInBreps(Brep=cap, Point=demesh.Vertices, Strict=False)  # -> Inside, Index
brepsinc_2 = PointInBreps(Brep=cap_2, Point=demesh_2.Vertices, Strict=False)  # -> Inside, Index
brepsinc_3 = PointInBreps(Brep=cap_3, Point=demesh_3.Vertices, Strict=False)  # -> Inside, Index
brepsinc_4 = PointInBreps(Brep=cap_4, Point=demesh_4.Vertices, Strict=False)  # -> Inside, Index
cullv = CullVertices(Mesh=move.Geometry, Pattern=brepsinc.Inside, Shrink=True)
cullv_2 = CullVertices(Mesh=move_2.Geometry, Pattern=brepsinc_2.Inside, Shrink=True)
cullv_3 = CullVertices(Mesh=move_3.Geometry, Pattern=brepsinc_3.Inside, Shrink=True)
cullv_4 = CullVertices(Mesh=move_4.Geometry, Pattern=brepsinc_4.Inside, Shrink=True)
demesh_5 = DeconstructMesh(Mesh=cullv)  # -> Vertices, Faces, Colours, Normals
demesh_6 = DeconstructMesh(Mesh=cullv_2)  # -> Vertices, Faces, Colours, Normals
demesh_7 = DeconstructMesh(Mesh=cullv_3)  # -> Vertices, Faces, Colours, Normals
demesh_8 = DeconstructMesh(Mesh=cullv_4)  # -> Vertices, Faces, Colours, Normals
panel_17 = Panel("""T
U
w""")
panel_18 = Panel("""T
U
w""")
panel_19 = Panel("""T
U
w""")
panel_20 = Panel("""T
U
w""")
probing = Probing(
    Run=Button(),
    Case=caserun.Case,
    ProbingName="probing01",
    InterpolationScheme="3",
    Fields=panel_17,
    ProbingPoints=demesh_5.Vertices)
probing_2 = Probing(
    Run=Button(),
    Case=caserun_2.Case,
    ProbingName="probing01",
    InterpolationScheme="3",
    Fields=panel_18,
    ProbingPoints=demesh_6.Vertices)
probing_3 = Probing(
    Run=Button(),
    Case=caserun_3.Case,
    ProbingName="probing01",
    InterpolationScheme="3",
    Fields=panel_19,
    ProbingPoints=demesh_7.Vertices)
probing_4 = Probing(
    Run=Button(),
    Case=caserun_4.Case,
    ProbingName="probing01",
    InterpolationScheme="3",
    Fields=panel_20,
    ProbingPoints=demesh_8.Vertices)
number_slider_32 = Slider(1, range=1..14)
number_slider_33 = Slider(1, range=1..14)
number_slider_34 = Slider(1, range=1..14)
number_slider_35 = Slider(1, range=1..14)
getprobes = GetProbes(Case=probing, ProbingName="probing01", Field="w")  # -> TimeSteps, simplify(ProbeValues)
getprobes_2 = GetProbes(Case=probing_2, ProbingName="probing01", Field="w")  # -> TimeSteps, simplify(ProbeValues)
getprobes_3 = GetProbes(Case=probing_3, ProbingName="probing01", Field="w")  # -> TimeSteps, simplify(ProbeValues)
getprobes_4 = GetProbes(Case=probing_4, ProbingName="probing01", Field="w")  # -> TimeSteps, simplify(ProbeValues)
getprobes_5 = GetProbes(Case=probing, ProbingName="probing01", Field="T")  # -> TimeSteps, simplify(ProbeValues)
getprobes_6 = GetProbes(Case=probing_2, ProbingName="probing01", Field="T")  # -> TimeSteps, simplify(ProbeValues)
getprobes_7 = GetProbes(Case=probing_3, ProbingName="probing01", Field="T")  # -> TimeSteps, simplify(ProbeValues)
getprobes_8 = GetProbes(Case=probing, ProbingName="probing01", Field="U")  # -> TimeSteps, simplify(ProbeValues)
getprobes_9 = GetProbes(Case=probing_2, ProbingName="probing01", Field="U")  # -> TimeSteps, simplify(ProbeValues)
getprobes_10 = GetProbes(Case=probing_3, ProbingName="probing01", Field="U")  # -> TimeSteps, simplify(ProbeValues)
getprobes_11 = GetProbes(Case=probing_4, ProbingName="probing01", Field="T")  # -> TimeSteps, simplify(ProbeValues)
getprobes_12 = GetProbes(Case=probing_4, ProbingName="probing01", Field="U")  # -> TimeSteps, simplify(ProbeValues)
data = Data(simplify(getprobes.ProbeValues))
data_2 = Data(simplify(getprobes_2.ProbeValues))
data_3 = Data(simplify(getprobes_3.ProbeValues))
data_4 = Data(simplify(getprobes_4.ProbeValues))
branch = TreeBranch(Tree=getprobes_8.ProbeValues, Path=number_slider_32, MaintainPaths=True)
branch_2 = TreeBranch(Tree=getprobes_5.ProbeValues, Path=number_slider_32, MaintainPaths=True)
branch_3 = TreeBranch(Tree=getprobes_9.ProbeValues, Path=number_slider_33, MaintainPaths=True)
branch_4 = TreeBranch(Tree=getprobes_6.ProbeValues, Path=number_slider_33, MaintainPaths=True)
branch_5 = TreeBranch(Tree=getprobes_10.ProbeValues, Path=number_slider_34, MaintainPaths=True)
branch_6 = TreeBranch(Tree=getprobes_7.ProbeValues, Path=number_slider_34, MaintainPaths=True)
branch_7 = TreeBranch(Tree=getprobes_12.ProbeValues, Path=number_slider_35, MaintainPaths=True)
branch_8 = TreeBranch(Tree=getprobes_11.ProbeValues, Path=number_slider_35, MaintainPaths=True)
branch_9 = TreeBranch(Tree=getprobes.ProbeValues, Path=number_slider_32, MaintainPaths=True)
branch_10 = TreeBranch(Tree=getprobes_2.ProbeValues, Path=number_slider_33, MaintainPaths=True)
branch_11 = TreeBranch(Tree=getprobes_3.ProbeValues, Path=number_slider_34, MaintainPaths=True)
branch_12 = TreeBranch(Tree=getprobes_4.ProbeValues, Path=number_slider_35, MaintainPaths=True)
vec = Vector(branch)
vec_2 = Vector(branch_3)
vec_3 = Vector(branch_5)
vec_4 = Vector(branch_7)
tag = TextTag3D(Location=demesh_5.Vertices, Text=branch_2, Size=Slider(0.07, range=0..1), Justification=5)  # disabled
tag_2 = TextTag3D(Location=demesh_6.Vertices, Text=branch_4, Size=Slider(0.07, range=0..1), Justification=5)  # disabled
tag_3 = TextTag3D(Location=demesh_7.Vertices, Text=branch_6, Size=Slider(0.07, range=0..1), Justification=5)  # disabled
tag_4 = TextTag3D(Location=demesh_8.Vertices, Text=branch_8, Size=Slider(0.07, range=0..1), Justification=5)  # disabled
vlen = VectorLength(Vector=vec)
average = Average(Input=vlen)
vlen_2 = VectorLength(Vector=vec_2)
average_2 = Average(Input=vlen_2)
vlen_3 = VectorLength(Vector=vec_3)
average_3 = Average(Input=vlen_3)
vlen_4 = VectorLength(Vector=vec_4)
average_4 = Average(Input=vlen_4)
python_3_script = Python3Script()  # -> out, a; inputs U: list
# ---------- python_3_script: Python ----------
"""Grasshopper Script"""
# requirements: matplotlib
a = "Hello Python 3 in Grasshopper!"
print(a)

import matplotlib.pyplot as plt

# Input: 'U,T,W' is a list of floats coming from Grasshopper
data = U,T,W # Ensure input_data is a list of floats

# Create a histogram
plt.hist(data, bins=10, edgecolor='black')  # Adjust the 'bins' as needed

# Add a title and labels
plt.title('Histogram of Input Data')
plt.xlabel('Value')
plt.ylabel('Frequency')

# Show the plot
plt.show()
# ---------- end python_3_script ----------
python_3_script_2 = Python3Script()  # -> out, a; inputs U: list; same code as python_3_script
python_3_script_3 = Python3Script()  # -> out, a; inputs U: list; same code as python_3_script
python_3_script_4 = Python3Script()  # -> out, a; inputs U: list; same code as python_3_script
panel_21 = Panel(average)
panel_22 = Panel(average_2)
panel_23 = Panel(average_3)
panel_24 = Panel(average_4)
bnd = Bounds(Numbers=vlen)
bnd_2 = Bounds(Numbers=vlen_2)
bnd_3 = Bounds(Numbers=vlen_3)
bnd_4 = Bounds(Numbers=branch_2)
bnd_5 = Bounds(Numbers=branch_4)
bnd_6 = Bounds(Numbers=branch_6)
bnd_7 = Bounds(Numbers=vlen_4)
bnd_8 = Bounds(Numbers=branch_8)
bnd_9 = Bounds(Numbers=branch_9)
bnd_10 = Bounds(Numbers=branch_10)
bnd_11 = Bounds(Numbers=branch_11)
bnd_12 = Bounds(Numbers=branch_12)
dom = ConstructDomain(DomainStart=Slider(0.2, range=0..10), DomainEnd=Slider(1.7, range=0..10))
dom_2 = ConstructDomain(DomainStart=Slider(0.2, range=0..10), DomainEnd=Slider(1.7, range=0..10))
dom_3 = ConstructDomain(DomainStart=Slider(0.2, range=0..10), DomainEnd=Slider(1.7, range=0..10))
dedomain = DeconstructDomain(Domain=bnd)  # -> Start, End
dedomain_2 = DeconstructDomain(Domain=bnd_2)  # -> Start, End
dedomain_3 = DeconstructDomain(Domain=bnd_3)  # -> Start, End
dom_4 = ConstructDomain(DomainStart=Slider(0.2, range=0..10), DomainEnd=Slider(1.7, range=0..10))
dedomain_4 = DeconstructDomain(Domain=bnd_7)  # -> Start, End
dedomain_5 = DeconstructDomain(Domain=bnd_4)  # -> Start, End
dedomain_6 = DeconstructDomain(Domain=bnd_5)  # -> Start, End
dedomain_7 = DeconstructDomain(Domain=bnd_6)  # -> Start, End
dedomain_8 = DeconstructDomain(Domain=bnd_8)  # -> Start, End
remap = RemapNumbers(Value=vlen, Source=bnd, Target=dom)  # -> Mapped, Clipped
remap_2 = RemapNumbers(Value=vlen_2, Source=bnd_2, Target=dom_2)  # -> Mapped, Clipped
remap_3 = RemapNumbers(Value=vlen_3, Source=bnd_3, Target=dom_3)  # -> Mapped, Clipped
dedomain_9 = DeconstructDomain(Domain=bnd_9)  # -> Start, End
dedomain_10 = DeconstructDomain(Domain=bnd_10)  # -> Start, End
dedomain_11 = DeconstructDomain(Domain=bnd_11)  # -> Start, End
remap_4 = RemapNumbers(Value=vlen_4, Source=bnd_7, Target=dom_4)  # -> Mapped, Clipped
dedomain_12 = DeconstructDomain(Domain=bnd_12)  # -> Start, End
gradient = Gradient(
    LowerLimit=dedomain.End,
    UpperLimit=dedomain.Start,
    Parameter=vlen,
    stops=[0: RGB(234, 38, 0), 0.25: RGB(234, 126, 0), 0.5: RGB(254, 244, 84), 0.75: RGB(173, 203, 249), 1: RGB(75, 107, 169)])
gradient_2 = Gradient(
    LowerLimit=dedomain_2.End,
    UpperLimit=dedomain_2.Start,
    Parameter=vlen_2,
    stops=[0: RGB(234, 38, 0), 0.25: RGB(234, 126, 0), 0.5: RGB(254, 244, 84), 0.75: RGB(173, 203, 249), 1: RGB(75, 107, 169)])
gradient_3 = Gradient(
    LowerLimit=dedomain_3.End,
    UpperLimit=dedomain_3.Start,
    Parameter=vlen_3,
    stops=[0: RGB(234, 38, 0), 0.25: RGB(234, 126, 0), 0.5: RGB(254, 244, 84), 0.75: RGB(173, 203, 249), 1: RGB(75, 107, 169)])
gradient_4 = Gradient(
    LowerLimit=dedomain_4.End,
    UpperLimit=dedomain_4.Start,
    Parameter=vlen_4,
    stops=[0: RGB(234, 38, 0), 0.25: RGB(234, 126, 0), 0.5: RGB(254, 244, 84), 0.75: RGB(173, 203, 249), 1: RGB(75, 107, 169)])
gradient_5 = Gradient(
    LowerLimit=dedomain_5.End,
    UpperLimit=dedomain_5.Start,
    Parameter=branch_2,
    stops=[0: RGB(234, 38, 0), 0.25: RGB(234, 126, 0), 0.5: RGB(254, 244, 84), 0.75: RGB(173, 203, 249), 1: RGB(75, 107, 169)])
gradient_6 = Gradient(
    LowerLimit=dedomain_6.End,
    UpperLimit=dedomain_6.Start,
    Parameter=branch_4,
    stops=[0: RGB(234, 38, 0), 0.25: RGB(234, 126, 0), 0.5: RGB(254, 244, 84), 0.75: RGB(173, 203, 249), 1: RGB(75, 107, 169)])
gradient_7 = Gradient(
    LowerLimit=dedomain_7.End,
    UpperLimit=dedomain_7.Start,
    Parameter=branch_6,
    stops=[0: RGB(234, 38, 0), 0.25: RGB(234, 126, 0), 0.5: RGB(254, 244, 84), 0.75: RGB(173, 203, 249), 1: RGB(75, 107, 169)])
gradient_8 = Gradient(
    LowerLimit=dedomain_8.End,
    UpperLimit=dedomain_8.Start,
    Parameter=branch_8,
    stops=[0: RGB(234, 38, 0), 0.25: RGB(234, 126, 0), 0.5: RGB(254, 244, 84), 0.75: RGB(173, 203, 249), 1: RGB(75, 107, 169)])
amp = Amplitude(Vector=vec, Amplitude=remap.Mapped)
amp_2 = Amplitude(Vector=vec_2, Amplitude=remap_2.Mapped)
amp_3 = Amplitude(Vector=vec_3, Amplitude=remap_3.Mapped)
amp_4 = Amplitude(Vector=vec_4, Amplitude=remap_4.Mapped)
gradient_9 = Gradient(
    LowerLimit=dedomain_9.End,
    UpperLimit=dedomain_9.Start,
    Parameter=branch_9,
    stops=[0: RGB(234, 38, 0), 0.25: RGB(234, 126, 0), 0.5: RGB(254, 244, 84), 0.75: RGB(173, 203, 249), 1: RGB(75, 107, 169)])
gradient_10 = Gradient(
    LowerLimit=dedomain_10.End,
    UpperLimit=dedomain_10.Start,
    Parameter=branch_10,
    stops=[0: RGB(234, 38, 0), 0.25: RGB(234, 126, 0), 0.5: RGB(254, 244, 84), 0.75: RGB(173, 203, 249), 1: RGB(75, 107, 169)])
gradient_11 = Gradient(
    LowerLimit=dedomain_11.End,
    UpperLimit=dedomain_11.Start,
    Parameter=branch_11,
    stops=[0: RGB(234, 38, 0), 0.25: RGB(234, 126, 0), 0.5: RGB(254, 244, 84), 0.75: RGB(173, 203, 249), 1: RGB(75, 107, 169)])
gradient_12 = Gradient(
    LowerLimit=dedomain_12.End,
    UpperLimit=dedomain_12.Start,
    Parameter=branch_12,
    stops=[0: RGB(234, 38, 0), 0.25: RGB(234, 126, 0), 0.5: RGB(254, 244, 84), 0.75: RGB(173, 203, 249), 1: RGB(75, 107, 169)])
conmesh = ConstructMesh(Vertices=demesh_5.Vertices, Faces=demesh_5.Faces, Colours=gradient_9)
conmesh_2 = ConstructMesh(Vertices=demesh_6.Vertices, Faces=demesh_6.Faces, Colours=gradient_10)
conmesh_3 = ConstructMesh(Vertices=demesh_7.Vertices, Faces=demesh_7.Faces, Colours=gradient_11)
conmesh_4 = ConstructMesh(Vertices=demesh_5.Vertices, Faces=demesh_5.Faces, Colours=gradient_5)
conmesh_5 = ConstructMesh(Vertices=demesh_6.Vertices, Faces=demesh_6.Faces, Colours=gradient_6)
conmesh_6 = ConstructMesh(Vertices=demesh_7.Vertices, Faces=demesh_7.Faces, Colours=gradient_7)
conmesh_7 = ConstructMesh(Vertices=demesh_8.Vertices, Faces=demesh_8.Faces, Colours=gradient_12)
conmesh_8 = ConstructMesh(Vertices=demesh_8.Vertices, Faces=demesh_8.Faces, Colours=gradient_8)
vdisex = VectorDisplayEx(Point=demesh_5.Vertices, Vector=amp, Colour=gradient, Width=2)
vdisex_2 = VectorDisplayEx(Point=demesh_6.Vertices, Vector=amp_2, Colour=gradient_2, Width=2)
vdisex_3 = VectorDisplayEx(Point=demesh_7.Vertices, Vector=amp_3, Colour=gradient_3, Width=2)
vdisex_4 = VectorDisplayEx(Point=demesh_8.Vertices, Vector=amp_4, Colour=gradient_4, Width=2)
number_slider_36 = Slider(0.32, range=0..1)
number_slider_37 = Slider(0.32, range=0..1)
number_slider_38 = Slider(0.32, range=0..1)
number_slider_39 = Slider(0.32, range=0..1)
custom_mesh_settings_5 = SettingsCustom(
    StitchSeams=True,
    SimplePlanes=False,
    Refine=True,
    MinCount=16,
    MaxCount=400,
    AspectRatio=20,
    MaxDistance=0,
    MaxAngle=20,
    MinEdge=number_slider_36,
    MaxEdge=number_slider_36)
custom_mesh_settings_6 = SettingsCustom(
    StitchSeams=True,
    SimplePlanes=False,
    Refine=True,
    MinCount=16,
    MaxCount=400,
    AspectRatio=20,
    MaxDistance=0,
    MaxAngle=20,
    MinEdge=number_slider_37,
    MaxEdge=number_slider_37)
custom_mesh_settings_7 = SettingsCustom(
    StitchSeams=True,
    SimplePlanes=False,
    Refine=True,
    MinCount=16,
    MaxCount=400,
    AspectRatio=20,
    MaxDistance=0,
    MaxAngle=20,
    MinEdge=number_slider_38,
    MaxEdge=number_slider_38)
# Setup
number_slider_40 = Slider(10, range=0..10)
custom_mesh_settings_8 = SettingsCustom(
    StitchSeams=True,
    SimplePlanes=False,
    Refine=True,
    MinCount=16,
    MaxCount=400,
    AspectRatio=20,
    MaxDistance=0,
    MaxAngle=20,
    MinEdge=number_slider_39,
    MaxEdge=number_slider_39)
brep_9 = Brep([<brep referenced from the Rhino model> x2])
brep_10 = Brep([<brep referenced from the Rhino model> x2])
brep_11 = Brep([<brep referenced from the Rhino model> x2])
brep_12 = Brep([<brep referenced from the Rhino model> x3])
brep_13 = Brep([<brep referenced from the Rhino model> x3])
brep_14 = Brep([<brep referenced from the Rhino model> x3])
number_slider_41 = Slider(0, range=0..100)
number_slider_42 = Slider(0, range=0..100)
number_slider_43 = Slider(0, range=0..100)
number_slider_44 = Slider(8.2, range=0..100)
number_slider_45 = Slider(11, range=0..100)
number_slider_46 = Slider(4.7, range=0..100)
number_slider_47 = Slider(8.2, range=0..100)
number_slider_48 = Slider(11, range=0..100)
number_slider_49 = Slider(4.7, range=0..100)
number_slider_50 = Slider(8.2, range=0..100)
number_slider_51 = Slider(11, range=0..100)
number_slider_52 = Slider(4.7, range=0..100)
number_slider_53 = Slider(14, range=0..100)
number_slider_54 = Slider(3.4, range=0..100)
number_slider_55 = Slider(14, range=0..100)
number_slider_56 = Slider(3.4, range=0..100)
number_slider_57 = Slider(14, range=0..100)
number_slider_58 = Slider(3.4, range=0..100)
brep_15 = Brep([<brep referenced from the Rhino model> x2])
X_5 = UnitX(Factor=1)
X_6 = UnitX(Factor=1)
X_7 = UnitX(Factor=1)
rotate_5 = Rotate(Geometry=X_5, Angle=degrees(Slider(0, range=0..100)), Plane=PlaneXY(0, 0, 0))  # -> Geometry, Transform
rotate_6 = Rotate(Geometry=X_6, Angle=degrees(Slider(0, range=0..100)), Plane=PlaneXY(0, 0, 0))  # -> Geometry, Transform
rotate_7 = Rotate(Geometry=X_7, Angle=degrees(Slider(0, range=0..100)), Plane=PlaneXY(0, 0, 0))  # -> Geometry, Transform
mesh_17 = MeshBrep(Brep=brep_9, Settings=custom_mesh_settings_5)
mesh_18 = MeshBrep(Brep=brep_10, Settings=custom_mesh_settings_6)
mesh_19 = MeshBrep(Brep=brep_11, Settings=custom_mesh_settings_7)
brep_16 = Brep([<brep referenced from the Rhino model> x3])
number_slider_59 = Slider(0, range=0..100)
number_slider_60 = Slider(8.2, range=0..100)
number_slider_61 = Slider(11, range=0..100)
number_slider_62 = Slider(4.7, range=0..100)
number_slider_63 = Slider(14, range=0..100)
number_slider_64 = Slider(3.4, range=0..100)
vegproperties_5 = VegetationProperties(
    H=Slider(3, range=0..15),
    L=Slider(0.05, range=0..0.15),
    RsMin=Slider(400, range=0..10000),
    NEvapSides=Slider(1, range=0..1))
vegproperties_6 = VegetationProperties(
    H=Slider(3, range=0..15),
    L=Slider(0.05, range=0..0.15),
    RsMin=Slider(400, range=0..10000),
    NEvapSides=Slider(1, range=0..1))
vegproperties_7 = VegetationProperties(
    H=Slider(3, range=0..15),
    L=Slider(0.05, range=0..0.15),
    RsMin=Slider(400, range=0..10000),
    NEvapSides=Slider(1, range=0..1))
X_8 = UnitX(Factor=1)
mesh_20 = MeshBrep(Brep=brep_12, Settings=custom_mesh_settings_5)
mesh_21 = MeshBrep(Brep=brep_13, Settings=custom_mesh_settings_6)
mesh_22 = MeshBrep(Brep=brep_14, Settings=custom_mesh_settings_7)
abl_5 = ABLCondition(WindSpeed=number_slider_40, Height=Slider(10, range=0..10), WindDirection=rotate_5.Geometry)
abl_6 = ABLCondition(WindSpeed=Slider(10, range=0..10), Height=Slider(10, range=0..10), WindDirection=rotate_6.Geometry)
abl_7 = ABLCondition(WindSpeed=Slider(10, range=0..10), Height=Slider(10, range=0..10), WindDirection=rotate_7.Geometry)
boxdomaindim_5 = BoxDomainDimensions(
    CellSize=Slider(15, range=0..100),
    FrontAdd=Slider(0, range=0..100),
    BackAdd=Slider(0, range=0..100),
    SidesAdd=Slider(0, range=0..100),
    TopAdd=Slider(0, range=0..100),
    RefinementBoxAdd=Slider(15, range=0..100))
boxdomaindim_6 = BoxDomainDimensions(
    CellSize=Slider(15, range=0..100),
    FrontAdd=Slider(0, range=0..100),
    BackAdd=Slider(0, range=0..100),
    SidesAdd=Slider(0, range=0..100),
    TopAdd=Slider(0, range=0..100),
    RefinementBoxAdd=Slider(15, range=0..100))
boxdomaindim_7 = BoxDomainDimensions(
    CellSize=Slider(15, range=0..100),
    FrontAdd=Slider(0, range=0..100),
    BackAdd=Slider(0, range=0..100),
    SidesAdd=Slider(0, range=0..100),
    TopAdd=Slider(0, range=0..100),
    RefinementBoxAdd=Slider(15, range=0..100))
rotate_8 = Rotate(Geometry=X_8, Angle=degrees(Slider(0, range=0..100)), Plane=PlaneXY(0, 0, 0))  # -> Geometry, Transform
mesh_23 = MeshBrep(Brep=brep_15, Settings=custom_mesh_settings_8)
vegproperties_8 = VegetationProperties(
    H=Slider(3, range=0..15),
    L=Slider(0.05, range=0..0.15),
    RsMin=Slider(400, range=0..10000),
    NEvapSides=Slider(1, range=0..1))
mesh_24 = MeshBrep(Brep=brep_16, Settings=custom_mesh_settings_8)
brick_5 = BuildingMaterialHamstad5Brick()
brick_6 = BuildingMaterialHamstad5Brick()
brick_7 = BuildingMaterialHamstad5Brick()
abl_8 = ABLCondition(WindSpeed=Slider(10, range=0..10), Height=Slider(10, range=0..10), WindDirection=rotate_8.Geometry)
mesh_25 = Mesh([<mesh referenced from the Rhino model> x3])
mesh_26 = Mesh([<mesh referenced from the Rhino model> x4])
mesh_27 = Mesh([<mesh referenced from the Rhino model> x3])
mesh_28 = Mesh([<mesh referenced from the Rhino model> x4])
mesh_29 = Mesh([<mesh referenced from the Rhino model> x3])
mesh_30 = Mesh([<mesh referenced from the Rhino model> x4])
boxdomaindim_8 = BoxDomainDimensions(
    CellSize=Slider(15, range=0..100),
    FrontAdd=Slider(0, range=0..100),
    BackAdd=Slider(0, range=0..100),
    SidesAdd=Slider(0, range=0..100),
    TopAdd=Slider(0, range=0..100),
    RefinementBoxAdd=Slider(15, range=0..100))
airregion_5 = AirRegion(ABLConditionSetting=abl_5, BoxDomainParameters=boxdomaindim_5)
airregion_6 = AirRegion(ABLConditionSetting=abl_6, BoxDomainParameters=boxdomaindim_6)
airregion_7 = AirRegion(ABLConditionSetting=abl_7, BoxDomainParameters=boxdomaindim_7)
vegregion_5 = VegetationRegion(VegetationMesh=mesh_26, LAD=Slider(1.5, range=0..5), VegetationProperties=vegproperties_5)
vegregion_6 = VegetationRegion(VegetationMesh=mesh_28, LAD=Slider(1.5, range=0..5), VegetationProperties=vegproperties_6)
vegregion_7 = VegetationRegion(VegetationMesh=mesh_30, LAD=Slider(1.5, range=0..5), VegetationProperties=vegproperties_7)
solidregion_5 = SolidRegion(SolidRegionName="Building", Mesh=mesh_17, Material=brick_5, BuildingTemperature=Slider(16, range=0..100))
solidregion_6 = SolidRegion(SolidRegionName="Building", Mesh=mesh_18, Material=brick_6, BuildingTemperature=Slider(16, range=0..100))
solidregion_7 = SolidRegion(SolidRegionName="Building", Mesh=mesh_19, Material=brick_7, BuildingTemperature=Slider(16, range=0..100))
brick_8 = BuildingMaterialHamstad5Brick()
mesh_31 = Mesh([<mesh referenced from the Rhino model> x3])
mesh_32 = Mesh([<mesh referenced from the Rhino model> x4])
path_9 = FilePath("C:\Users\crothe3\GaTech Dropbox\Chinmay Rothe\UMCF\CR_Vegetation Siulation files\USA_GA_Atlanta-Hartsfield-Jackson.Intl.AP.722190_TMYx\USA_GA_Atlanta-Hartsfield-Jackson.Intl.AP.722190_TMYx.epw")
duration_5 = Slider(5, range=0..24)
path_10 = FilePath("C:\Users\crothe3\GaTech Dropbox\Chinmay Rothe\UMCF\CR_Vegetation Siulation files\USA_GA_Atlanta-Hartsfield-Jackson.Intl.AP.722190_TMYx\USA_GA_Atlanta-Hartsfield-Jackson.Intl.AP.722190_TMYx.epw")
duration_6 = Slider(5, range=0..24)
path_11 = FilePath("C:\Users\crothe3\GaTech Dropbox\Chinmay Rothe\UMCF\CR_Vegetation Siulation files\USA_GA_Atlanta-Hartsfield-Jackson.Intl.AP.722190_TMYx\USA_GA_Atlanta-Hartsfield-Jackson.Intl.AP.722190_TMYx.epw")
duration_7 = Slider(5, range=0..24)
airregion_8 = AirRegion(ABLConditionSetting=abl_8, BoxDomainParameters=boxdomaindim_8)
vegregion_8 = VegetationRegion(VegetationMesh=mesh_32, LAD=Slider(1.5, range=0..5), VegetationProperties=vegproperties_8)
solidregion_8 = SolidRegion(SolidRegionName="Building", Mesh=mesh_23, Material=brick_8, BuildingTemperature=Slider(16, range=0..100))
weather_5 = Weather(EPWFilePath=path_9)
weather_6 = Weather(EPWFilePath=path_10)
weather_7 = Weather(EPWFilePath=path_11)
path_12 = FilePath("C:\Users\crothe3\GaTech Dropbox\Chinmay Rothe\UMCF\CR_Vegetation Siulation files\USA_GA_Atlanta-Hartsfield-Jackson.Intl.AP.722190_TMYx\USA_GA_Atlanta-Hartsfield-Jackson.Intl.AP.722190_TMYx.epw")
duration_8 = Slider(5, range=0..24)
weather_8 = Weather(EPWFilePath=path_12)
timing_5 = TimingParameters(Weather=weather_5, StartDay=Slider(171, range=0..364), StartTime=Slider(11, range=0..23), Duration=duration_5)
timing_6 = TimingParameters(Weather=weather_6, StartDay=Slider(171, range=0..364), StartTime=Slider(11, range=0..23), Duration=duration_6)
timing_7 = TimingParameters(Weather=weather_7, StartDay=Slider(171, range=0..364), StartTime=Slider(11, range=0..23), Duration=duration_7)
simsettings_5 = SimulationSettings(NumberOfCPUs=Slider(12, range=0..20), MaxFluidIteration=Slider(100, range=0..1000))
simsettings_6 = SimulationSettings(NumberOfCPUs=Slider(12, range=0..20), MaxFluidIteration=Slider(100, range=0..1000))
simsettings_7 = SimulationSettings(NumberOfCPUs=Slider(12, range=0..20), MaxFluidIteration=Slider(100, range=0..1000))
desetting_5 = DeconstructSetting(Setting=timing_5)  # -> Entries, ListContainers
desetting_6 = DeconstructSetting(Setting=timing_6)  # -> Entries, ListContainers
desetting_7 = DeconstructSetting(Setting=timing_7)  # -> Entries, ListContainers
timing_8 = TimingParameters(Weather=weather_8, StartDay=Slider(171, range=0..364), StartTime=Slider(11, range=0..23), Duration=duration_8)
simsettings_8 = SimulationSettings(NumberOfCPUs=Slider(12, range=0..20), MaxFluidIteration=Slider(100, range=0..1000))
write_5 = Button()
write_6 = Button()
write_7 = Button()
clear_5 = Button()
clear_6 = Button()
clear_7 = Button()
path_13 = FilePath("C:\MetaFoam_Cases\")
path_14 = FilePath("C:\MetaFoam_Cases\")
path_15 = FilePath("C:\MetaFoam_Cases\")
desetting_8 = DeconstructSetting(Setting=timing_8)  # -> Entries, ListContainers
write_8 = Button()
clear_8 = Button()
item_13 = ListItem(List=desetting_5.ListContainers, Index=Slider(4, range=0..10), Wrap=True)
item_14 = ListItem(List=desetting_6.ListContainers, Index=Slider(4, range=0..10), Wrap=True)
item_15 = ListItem(List=desetting_7.ListContainers, Index=Slider(4, range=0..10), Wrap=True)
path_16 = FilePath("C:\MetaFoam_Cases\")
umcf_case_5 = UrbabMicroClimateFoamCase(
    WriteCase=write_5,
    ClearCase=clear_5,
    NewCaseName="CR_VS-UMCF_J-DOE09d",
    WorkingDirectory=path_13,
    AirRegion=airregion_5,
    VegetationRegions=vegregion_5,
    SolidRegions=solidregion_5,
    TimingSettings=timing_5,
    SimulationSettings=simsettings_5)  # -> ModificationLogs, Case, DomainBox, RefinementBox
umcf_case_6 = UrbabMicroClimateFoamCase(
    WriteCase=write_6,
    ClearCase=clear_6,
    NewCaseName="CR_VS-UMCF_J-DOE09d",
    WorkingDirectory=path_14,
    AirRegion=airregion_6,
    VegetationRegions=vegregion_6,
    SolidRegions=solidregion_6,
    TimingSettings=timing_6,
    SimulationSettings=simsettings_6)  # -> ModificationLogs, Case, DomainBox, RefinementBox
umcf_case_7 = UrbabMicroClimateFoamCase(
    WriteCase=write_7,
    ClearCase=clear_7,
    NewCaseName="CR_VS-UMCF_J-DOE09d",
    WorkingDirectory=path_15,
    AirRegion=airregion_7,
    VegetationRegions=vegregion_7,
    SolidRegions=solidregion_7,
    TimingSettings=timing_7,
    SimulationSettings=simsettings_7)  # -> ModificationLogs, Case, DomainBox, RefinementBox
defilecontainer_5 = DeconstructFileContainer(FileContainer=item_13)  # -> Name, FileType, Keys, Values, RawContent, TotalRawContent
defilecontainer_6 = DeconstructFileContainer(FileContainer=item_14)  # -> Name, FileType, Keys, Values, RawContent, TotalRawContent
defilecontainer_7 = DeconstructFileContainer(FileContainer=item_15)  # -> Name, FileType, Keys, Values, RawContent, TotalRawContent
item_16 = ListItem(List=desetting_8.ListContainers, Index=Slider(4, range=0..10), Wrap=True)
panel_25 = Panel(defilecontainer_5.Name)
panel_26 = Panel(defilecontainer_6.Name)
panel_27 = Panel(defilecontainer_7.Name)
rep_9 = ReplaceText(Text=defilecontainer_5.Values, Find="(", RecursiveReplace=False)
rep_10 = ReplaceText(Text=defilecontainer_6.Values, Find="(", RecursiveReplace=False)
rep_11 = ReplaceText(Text=defilecontainer_7.Values, Find="(", RecursiveReplace=False)
panel_28 = Panel(defilecontainer_5.RawContent)
panel_29 = Panel(defilecontainer_6.RawContent)
panel_30 = Panel(defilecontainer_7.RawContent)
umcf_case_8 = UrbabMicroClimateFoamCase(
    WriteCase=write_8,
    ClearCase=clear_8,
    NewCaseName="CR_VS-UMCF_J-DOE09d",
    WorkingDirectory=path_16,
    AirRegion=airregion_8,
    VegetationRegions=vegregion_8,
    SolidRegions=solidregion_8,
    TimingSettings=timing_8,
    SimulationSettings=simsettings_8)  # -> ModificationLogs, Case, DomainBox, RefinementBox
wires_9 = BrepWireframe(Brep=umcf_case_5.DomainBox, Density=-1)
wires_10 = BrepWireframe(Brep=umcf_case_6.DomainBox, Density=-1)
wires_11 = BrepWireframe(Brep=umcf_case_7.DomainBox, Density=-1)
defilecontainer_8 = DeconstructFileContainer(FileContainer=item_16)  # -> Name, FileType, Keys, Values, RawContent, TotalRawContent
wires_12 = BrepWireframe(Brep=umcf_case_5.RefinementBox, Density=-1)
wires_13 = BrepWireframe(Brep=umcf_case_6.RefinementBox, Density=-1)
wires_14 = BrepWireframe(Brep=umcf_case_7.RefinementBox, Density=-1)
panel_31 = Panel(umcf_case_5.ModificationLogs)
panel_32 = Panel(umcf_case_6.ModificationLogs)
panel_33 = Panel(umcf_case_7.ModificationLogs)
rep_12 = ReplaceText(Text=rep_9, Find=")", RecursiveReplace=False)
rep_13 = ReplaceText(Text=rep_10, Find=")", RecursiveReplace=False)
rep_14 = ReplaceText(Text=rep_11, Find=")", RecursiveReplace=False)
panel_34 = Panel(defilecontainer_8.Name)
preview_13 = CustomPreview(Geometry=wires_9, Material=ColourSwatch(SwatchColor=RGB(97, 97, 97)))
preview_14 = CustomPreview(Geometry=wires_10, Material=ColourSwatch(SwatchColor=RGB(97, 97, 97)))
preview_15 = CustomPreview(Geometry=wires_11, Material=ColourSwatch(SwatchColor=RGB(97, 97, 97)))
preview_16 = CustomPreview(Geometry=wires_12, Material=ColourSwatch(SwatchColor=RGB(230, 230, 230)))
preview_17 = CustomPreview(Geometry=wires_13, Material=ColourSwatch(SwatchColor=RGB(230, 230, 230)))
preview_18 = CustomPreview(Geometry=wires_14, Material=ColourSwatch(SwatchColor=RGB(230, 230, 230)))
rep_15 = ReplaceText(Text=defilecontainer_8.Values, Find="(", RecursiveReplace=False)
panel_35 = Panel(defilecontainer_8.RawContent)
wires_15 = BrepWireframe(Brep=umcf_case_8.DomainBox, Density=-1)
split_5 = TextSplit(Text=rep_12, Separators=" ")  # disabled
split_6 = TextSplit(Text=rep_13, Separators=" ")  # disabled
split_7 = TextSplit(Text=rep_14, Separators=" ")  # disabled
wires_16 = BrepWireframe(Brep=umcf_case_8.RefinementBox, Density=-1)
caserun_5 = CaseRun(
    Case=umcf_case_5.Case,
    PrepareSimulation=Button(),
    PrepareSimulationInParallel=Button(),
    RunSimulation=Button(),
    RunSimulationInParallel=Button())  # -> Case, LogFileNames, LogFileContent
caserun_6 = CaseRun(
    Case=umcf_case_6.Case,
    PrepareSimulation=Button(),
    PrepareSimulationInParallel=Button(),
    RunSimulation=Button(),
    RunSimulationInParallel=Button())  # -> Case, LogFileNames, LogFileContent
caserun_7 = CaseRun(
    Case=umcf_case_7.Case,
    PrepareSimulation=Button(),
    PrepareSimulationInParallel=Button(),
    RunSimulation=Button(),
    RunSimulationInParallel=Button())  # -> Case, LogFileNames, LogFileContent
panel_36 = Panel(umcf_case_8.ModificationLogs)
rep_16 = ReplaceText(Text=rep_15, Find=")", RecursiveReplace=False)
item_17 = ListItem(List=split_5, Index=0, Wrap=True)  # -> Item, Item1, Item2; disabled
item_18 = ListItem(List=split_6, Index=0, Wrap=True)  # -> Item, Item1, Item2; disabled
item_19 = ListItem(List=split_7, Index=0, Wrap=True)  # -> Item, Item1, Item2; disabled
preview_19 = CustomPreview(Geometry=wires_15, Material=ColourSwatch(SwatchColor=RGB(97, 97, 97)))
preview_20 = CustomPreview(Geometry=wires_16, Material=ColourSwatch(SwatchColor=RGB(230, 230, 230)))
debrep_5 = DeconstructBrep(Brep=umcf_case_5.DomainBox)  # -> Faces, Edges, Vertices
debrep_6 = DeconstructBrep(Brep=umcf_case_6.DomainBox)  # -> Faces, Edges, Vertices
debrep_7 = DeconstructBrep(Brep=umcf_case_7.DomainBox)  # -> Faces, Edges, Vertices
split_8 = TextSplit(Text=rep_16, Separators=" ")  # disabled
caserun_8 = CaseRun(
    Case=umcf_case_8.Case,
    PrepareSimulation=Button(),
    PrepareSimulationInParallel=Button(),
    RunSimulation=Button(),
    RunSimulationInParallel=Button())  # -> Case, LogFileNames, LogFileContent
item_20 = ListItem(List=split_8, Index=0, Wrap=True)  # -> Item, Item1, Item2; disabled
debrep_8 = DeconstructBrep(Brep=umcf_case_8.DomainBox)  # -> Faces, Edges, Vertices
pt_5 = ConstructPoint(XCoordinate=item_17.Item, YCoordinate=item_17.Item1, ZCoordinate=item_17.Item2)  # disabled
pt_6 = ConstructPoint(XCoordinate=item_18.Item, YCoordinate=item_18.Item1, ZCoordinate=item_18.Item2)  # disabled
pt_7 = ConstructPoint(XCoordinate=item_19.Item, YCoordinate=item_19.Item1, ZCoordinate=item_19.Item2)  # disabled
item_21 = ListItem(List=debrep_5.Faces, Index=Slider(4, range=0..10), Wrap=True)
item_22 = ListItem(List=debrep_6.Faces, Index=Slider(4, range=0..10), Wrap=True)
item_23 = ListItem(List=debrep_7.Faces, Index=Slider(4, range=0..10), Wrap=True)
pt_8 = ConstructPoint(XCoordinate=item_20.Item, YCoordinate=item_20.Item1, ZCoordinate=item_20.Item2)  # disabled
panel_37 = Panel(defilecontainer_5.Values)
panel_38 = Panel(defilecontainer_6.Values)
panel_39 = Panel(defilecontainer_7.Values)
crv_5 = Curve(item_21)
crv_6 = Curve(item_22)
crv_7 = Curve(item_23)
item_24 = ListItem(List=debrep_8.Faces, Index=Slider(4, range=0..10), Wrap=True)
mesh_uv_5 = MeshSurface(Surface=item_21, UCount=Slider(49, range=0..100), VCount=Slider(31, range=0..100), Overhang=True, Equalize=False)
mesh_uv_6 = MeshSurface(Surface=item_22, UCount=Slider(49, range=0..100), VCount=Slider(31, range=0..100), Overhang=True, Equalize=False)
mesh_uv_7 = MeshSurface(Surface=item_23, UCount=Slider(49, range=0..100), VCount=Slider(31, range=0..100), Overhang=True, Equalize=False)
cap_5 = CapHoles(Brep=brep_9)
cap_6 = CapHoles(Brep=brep_10)
cap_7 = CapHoles(Brep=brep_11)
panel_40 = Panel(defilecontainer_8.Values)
Z_5 = UnitZ(Factor=Slider(2, range=0..10))
Z_6 = UnitZ(Factor=Slider(2, range=0..10))
Z_7 = UnitZ(Factor=Slider(2, range=0..10))
preview_21 = CustomPreview(Geometry=crv_5, Material=ColourSwatch(SwatchColor=RGB(0, 0, 0)))
preview_22 = CustomPreview(Geometry=crv_6, Material=ColourSwatch(SwatchColor=RGB(0, 0, 0)))
preview_23 = CustomPreview(Geometry=crv_7, Material=ColourSwatch(SwatchColor=RGB(0, 0, 0)))
crv_8 = Curve(item_24)
mesh_uv_8 = MeshSurface(Surface=item_24, UCount=Slider(49, range=0..100), VCount=Slider(31, range=0..100), Overhang=True, Equalize=False)
cap_8 = CapHoles(Brep=brep_15)
move_5 = Move(Geometry=mesh_uv_5, Motion=Z_5)  # -> Geometry, Transform
move_6 = Move(Geometry=mesh_uv_6, Motion=Z_6)  # -> Geometry, Transform
move_7 = Move(Geometry=mesh_uv_7, Motion=Z_7)  # -> Geometry, Transform
Z_8 = UnitZ(Factor=Slider(2, range=0..10))
preview_24 = CustomPreview(Geometry=crv_8, Material=ColourSwatch(SwatchColor=RGB(0, 0, 0)))
demesh_9 = DeconstructMesh(Mesh=move_5.Geometry)  # -> Vertices, Faces, Colours, Normals
demesh_10 = DeconstructMesh(Mesh=move_6.Geometry)  # -> Vertices, Faces, Colours, Normals
demesh_11 = DeconstructMesh(Mesh=move_7.Geometry)  # -> Vertices, Faces, Colours, Normals
move_8 = Move(Geometry=mesh_uv_8, Motion=Z_8)  # -> Geometry, Transform
brepsinc_5 = PointInBreps(Brep=cap_5, Point=demesh_9.Vertices, Strict=False)  # -> Inside, Index
brepsinc_6 = PointInBreps(Brep=cap_6, Point=demesh_10.Vertices, Strict=False)  # -> Inside, Index
brepsinc_7 = PointInBreps(Brep=cap_7, Point=demesh_11.Vertices, Strict=False)  # -> Inside, Index
demesh_12 = DeconstructMesh(Mesh=move_8.Geometry)  # -> Vertices, Faces, Colours, Normals
cullv_5 = CullVertices(Mesh=move_5.Geometry, Pattern=brepsinc_5.Inside, Shrink=True)
cullv_6 = CullVertices(Mesh=move_6.Geometry, Pattern=brepsinc_6.Inside, Shrink=True)
cullv_7 = CullVertices(Mesh=move_7.Geometry, Pattern=brepsinc_7.Inside, Shrink=True)
brepsinc_8 = PointInBreps(Brep=cap_8, Point=demesh_12.Vertices, Strict=False)  # -> Inside, Index
demesh_13 = DeconstructMesh(Mesh=cullv_5)  # -> Vertices, Faces, Colours, Normals
demesh_14 = DeconstructMesh(Mesh=cullv_6)  # -> Vertices, Faces, Colours, Normals
demesh_15 = DeconstructMesh(Mesh=cullv_7)  # -> Vertices, Faces, Colours, Normals
cullv_8 = CullVertices(Mesh=move_8.Geometry, Pattern=brepsinc_8.Inside, Shrink=True)
panel_41 = Panel("""T
U
w""")
panel_42 = Panel("""T
U
w""")
panel_43 = Panel("""T
U
w""")
demesh_16 = DeconstructMesh(Mesh=cullv_8)  # -> Vertices, Faces, Colours, Normals
panel_44 = Panel("""T
U
w""")
probing_5 = Probing(
    Run=Button(),
    Case=caserun_5.Case,
    ProbingName="probing01",
    InterpolationScheme="3",
    Fields=panel_41,
    ProbingPoints=demesh_13.Vertices)
probing_6 = Probing(
    Run=Button(),
    Case=caserun_6.Case,
    ProbingName="probing01",
    InterpolationScheme="3",
    Fields=panel_42,
    ProbingPoints=demesh_14.Vertices)
probing_7 = Probing(
    Run=Button(),
    Case=caserun_7.Case,
    ProbingName="probing01",
    InterpolationScheme="3",
    Fields=panel_43,
    ProbingPoints=demesh_15.Vertices)
probing_8 = Probing(
    Run=Button(),
    Case=caserun_8.Case,
    ProbingName="probing01",
    InterpolationScheme="3",
    Fields=panel_44,
    ProbingPoints=demesh_16.Vertices)
number_slider_65 = Slider(1, range=1..14)
number_slider_66 = Slider(1, range=1..14)
number_slider_67 = Slider(1, range=1..14)
getprobes_13 = GetProbes(Case=probing_5, ProbingName="probing01", Field="w")  # -> TimeSteps, simplify(ProbeValues)
getprobes_14 = GetProbes(Case=probing_6, ProbingName="probing01", Field="w")  # -> TimeSteps, simplify(ProbeValues)
getprobes_15 = GetProbes(Case=probing_7, ProbingName="probing01", Field="w")  # -> TimeSteps, simplify(ProbeValues)
getprobes_16 = GetProbes(Case=probing_5, ProbingName="probing01", Field="T")  # -> TimeSteps, simplify(ProbeValues)
getprobes_17 = GetProbes(Case=probing_6, ProbingName="probing01", Field="T")  # -> TimeSteps, simplify(ProbeValues)
getprobes_18 = GetProbes(Case=probing_7, ProbingName="probing01", Field="T")  # -> TimeSteps, simplify(ProbeValues)
getprobes_19 = GetProbes(Case=probing_5, ProbingName="probing01", Field="U")  # -> TimeSteps, simplify(ProbeValues)
getprobes_20 = GetProbes(Case=probing_6, ProbingName="probing01", Field="U")  # -> TimeSteps, simplify(ProbeValues)
getprobes_21 = GetProbes(Case=probing_7, ProbingName="probing01", Field="U")  # -> TimeSteps, simplify(ProbeValues)
number_slider_68 = Slider(1, range=1..14)
data_5 = Data(simplify(getprobes_13.ProbeValues))
data_6 = Data(simplify(getprobes_14.ProbeValues))
data_7 = Data(simplify(getprobes_15.ProbeValues))
getprobes_22 = GetProbes(Case=probing_8, ProbingName="probing01", Field="w")  # -> TimeSteps, simplify(ProbeValues)
getprobes_23 = GetProbes(Case=probing_8, ProbingName="probing01", Field="T")  # -> TimeSteps, simplify(ProbeValues)
getprobes_24 = GetProbes(Case=probing_8, ProbingName="probing01", Field="U")  # -> TimeSteps, simplify(ProbeValues)
branch_13 = TreeBranch(Tree=getprobes_19.ProbeValues, Path=number_slider_65, MaintainPaths=True)
branch_14 = TreeBranch(Tree=getprobes_16.ProbeValues, Path=number_slider_65, MaintainPaths=True)
branch_15 = TreeBranch(Tree=getprobes_20.ProbeValues, Path=number_slider_66, MaintainPaths=True)
branch_16 = TreeBranch(Tree=getprobes_17.ProbeValues, Path=number_slider_66, MaintainPaths=True)
branch_17 = TreeBranch(Tree=getprobes_21.ProbeValues, Path=number_slider_67, MaintainPaths=True)
branch_18 = TreeBranch(Tree=getprobes_18.ProbeValues, Path=number_slider_67, MaintainPaths=True)
branch_19 = TreeBranch(Tree=getprobes_13.ProbeValues, Path=number_slider_65, MaintainPaths=True)
branch_20 = TreeBranch(Tree=getprobes_14.ProbeValues, Path=number_slider_66, MaintainPaths=True)
branch_21 = TreeBranch(Tree=getprobes_15.ProbeValues, Path=number_slider_67, MaintainPaths=True)
data_8 = Data(simplify(getprobes_22.ProbeValues))
vec_5 = Vector(branch_13)
vec_6 = Vector(branch_15)
vec_7 = Vector(branch_17)
tag_5 = TextTag3D(Location=demesh_13.Vertices, Text=branch_14, Size=Slider(0.07, range=0..1), Justification=5)  # disabled
tag_6 = TextTag3D(Location=demesh_14.Vertices, Text=branch_16, Size=Slider(0.07, range=0..1), Justification=5)  # disabled
tag_7 = TextTag3D(Location=demesh_15.Vertices, Text=branch_18, Size=Slider(0.07, range=0..1), Justification=5)  # disabled
branch_22 = TreeBranch(Tree=getprobes_24.ProbeValues, Path=number_slider_68, MaintainPaths=True)
branch_23 = TreeBranch(Tree=getprobes_23.ProbeValues, Path=number_slider_68, MaintainPaths=True)
branch_24 = TreeBranch(Tree=getprobes_22.ProbeValues, Path=number_slider_68, MaintainPaths=True)
vlen_5 = VectorLength(Vector=vec_5)
average_5 = Average(Input=vlen_5)
vlen_6 = VectorLength(Vector=vec_6)
average_6 = Average(Input=vlen_6)
vlen_7 = VectorLength(Vector=vec_7)
average_7 = Average(Input=vlen_7)
vec_8 = Vector(branch_22)
python_3_script_5 = Python3Script()  # -> out, a; inputs U: list; same code as python_3_script
python_3_script_6 = Python3Script()  # -> out, a; inputs U: list; same code as python_3_script
python_3_script_7 = Python3Script()  # -> out, a; inputs U: list; same code as python_3_script
panel_45 = Panel(average_5)
panel_46 = Panel(average_6)
panel_47 = Panel(average_7)
tag_8 = TextTag3D(Location=demesh_16.Vertices, Text=branch_23, Size=Slider(0.07, range=0..1), Justification=5)  # disabled
vlen_8 = VectorLength(Vector=vec_8)
average_8 = Average(Input=vlen_8)
bnd_13 = Bounds(Numbers=vlen_5)
bnd_14 = Bounds(Numbers=vlen_6)
bnd_15 = Bounds(Numbers=vlen_7)
bnd_16 = Bounds(Numbers=branch_14)
bnd_17 = Bounds(Numbers=branch_16)
bnd_18 = Bounds(Numbers=branch_18)
python_3_script_8 = Python3Script()  # -> out, a; inputs U: list; same code as python_3_script
panel_48 = Panel(average_8)
bnd_19 = Bounds(Numbers=branch_19)
bnd_20 = Bounds(Numbers=branch_20)
bnd_21 = Bounds(Numbers=branch_21)
dom_5 = ConstructDomain(DomainStart=Slider(0.2, range=0..10), DomainEnd=Slider(1.7, range=0..10))
dom_6 = ConstructDomain(DomainStart=Slider(0.2, range=0..10), DomainEnd=Slider(1.7, range=0..10))
dom_7 = ConstructDomain(DomainStart=Slider(0.2, range=0..10), DomainEnd=Slider(1.7, range=0..10))
dedomain_13 = DeconstructDomain(Domain=bnd_13)  # -> Start, End
dedomain_14 = DeconstructDomain(Domain=bnd_14)  # -> Start, End
dedomain_15 = DeconstructDomain(Domain=bnd_15)  # -> Start, End
dedomain_16 = DeconstructDomain(Domain=bnd_16)  # -> Start, End
dedomain_17 = DeconstructDomain(Domain=bnd_17)  # -> Start, End
dedomain_18 = DeconstructDomain(Domain=bnd_18)  # -> Start, End
bnd_22 = Bounds(Numbers=vlen_8)
bnd_23 = Bounds(Numbers=branch_23)
remap_5 = RemapNumbers(Value=vlen_5, Source=bnd_13, Target=dom_5)  # -> Mapped, Clipped
remap_6 = RemapNumbers(Value=vlen_6, Source=bnd_14, Target=dom_6)  # -> Mapped, Clipped
remap_7 = RemapNumbers(Value=vlen_7, Source=bnd_15, Target=dom_7)  # -> Mapped, Clipped
dedomain_19 = DeconstructDomain(Domain=bnd_19)  # -> Start, End
dedomain_20 = DeconstructDomain(Domain=bnd_20)  # -> Start, End
dedomain_21 = DeconstructDomain(Domain=bnd_21)  # -> Start, End
bnd_24 = Bounds(Numbers=branch_24)
gradient_13 = Gradient(
    LowerLimit=dedomain_13.End,
    UpperLimit=dedomain_13.Start,
    Parameter=vlen_5,
    stops=[0: RGB(234, 38, 0), 0.25: RGB(234, 126, 0), 0.5: RGB(254, 244, 84), 0.75: RGB(173, 203, 249), 1: RGB(75, 107, 169)])
gradient_14 = Gradient(
    LowerLimit=dedomain_14.End,
    UpperLimit=dedomain_14.Start,
    Parameter=vlen_6,
    stops=[0: RGB(234, 38, 0), 0.25: RGB(234, 126, 0), 0.5: RGB(254, 244, 84), 0.75: RGB(173, 203, 249), 1: RGB(75, 107, 169)])
gradient_15 = Gradient(
    LowerLimit=dedomain_15.End,
    UpperLimit=dedomain_15.Start,
    Parameter=vlen_7,
    stops=[0: RGB(234, 38, 0), 0.25: RGB(234, 126, 0), 0.5: RGB(254, 244, 84), 0.75: RGB(173, 203, 249), 1: RGB(75, 107, 169)])
dom_8 = ConstructDomain(DomainStart=Slider(0.2, range=0..10), DomainEnd=Slider(1.7, range=0..10))
dedomain_22 = DeconstructDomain(Domain=bnd_22)  # -> Start, End
gradient_16 = Gradient(
    LowerLimit=dedomain_16.End,
    UpperLimit=dedomain_16.Start,
    Parameter=branch_14,
    stops=[0: RGB(234, 38, 0), 0.25: RGB(234, 126, 0), 0.5: RGB(254, 244, 84), 0.75: RGB(173, 203, 249), 1: RGB(75, 107, 169)])
gradient_17 = Gradient(
    LowerLimit=dedomain_17.End,
    UpperLimit=dedomain_17.Start,
    Parameter=branch_16,
    stops=[0: RGB(234, 38, 0), 0.25: RGB(234, 126, 0), 0.5: RGB(254, 244, 84), 0.75: RGB(173, 203, 249), 1: RGB(75, 107, 169)])
gradient_18 = Gradient(
    LowerLimit=dedomain_18.End,
    UpperLimit=dedomain_18.Start,
    Parameter=branch_18,
    stops=[0: RGB(234, 38, 0), 0.25: RGB(234, 126, 0), 0.5: RGB(254, 244, 84), 0.75: RGB(173, 203, 249), 1: RGB(75, 107, 169)])
dedomain_23 = DeconstructDomain(Domain=bnd_23)  # -> Start, End
amp_5 = Amplitude(Vector=vec_5, Amplitude=remap_5.Mapped)
amp_6 = Amplitude(Vector=vec_6, Amplitude=remap_6.Mapped)
amp_7 = Amplitude(Vector=vec_7, Amplitude=remap_7.Mapped)
gradient_19 = Gradient(
    LowerLimit=dedomain_19.End,
    UpperLimit=dedomain_19.Start,
    Parameter=branch_19,
    stops=[0: RGB(234, 38, 0), 0.25: RGB(234, 126, 0), 0.5: RGB(254, 244, 84), 0.75: RGB(173, 203, 249), 1: RGB(75, 107, 169)])
gradient_20 = Gradient(
    LowerLimit=dedomain_20.End,
    UpperLimit=dedomain_20.Start,
    Parameter=branch_20,
    stops=[0: RGB(234, 38, 0), 0.25: RGB(234, 126, 0), 0.5: RGB(254, 244, 84), 0.75: RGB(173, 203, 249), 1: RGB(75, 107, 169)])
gradient_21 = Gradient(
    LowerLimit=dedomain_21.End,
    UpperLimit=dedomain_21.Start,
    Parameter=branch_21,
    stops=[0: RGB(234, 38, 0), 0.25: RGB(234, 126, 0), 0.5: RGB(254, 244, 84), 0.75: RGB(173, 203, 249), 1: RGB(75, 107, 169)])
remap_8 = RemapNumbers(Value=vlen_8, Source=bnd_22, Target=dom_8)  # -> Mapped, Clipped
dedomain_24 = DeconstructDomain(Domain=bnd_24)  # -> Start, End
gradient_22 = Gradient(
    LowerLimit=dedomain_22.End,
    UpperLimit=dedomain_22.Start,
    Parameter=vlen_8,
    stops=[0: RGB(234, 38, 0), 0.25: RGB(234, 126, 0), 0.5: RGB(254, 244, 84), 0.75: RGB(173, 203, 249), 1: RGB(75, 107, 169)])
gradient_23 = Gradient(
    LowerLimit=dedomain_23.End,
    UpperLimit=dedomain_23.Start,
    Parameter=branch_23,
    stops=[0: RGB(234, 38, 0), 0.25: RGB(234, 126, 0), 0.5: RGB(254, 244, 84), 0.75: RGB(173, 203, 249), 1: RGB(75, 107, 169)])
amp_8 = Amplitude(Vector=vec_8, Amplitude=remap_8.Mapped)
gradient_24 = Gradient(
    LowerLimit=dedomain_24.End,
    UpperLimit=dedomain_24.Start,
    Parameter=branch_24,
    stops=[0: RGB(234, 38, 0), 0.25: RGB(234, 126, 0), 0.5: RGB(254, 244, 84), 0.75: RGB(173, 203, 249), 1: RGB(75, 107, 169)])
conmesh_9 = ConstructMesh(Vertices=demesh_13.Vertices, Faces=demesh_13.Faces, Colours=gradient_19)
conmesh_10 = ConstructMesh(Vertices=demesh_14.Vertices, Faces=demesh_14.Faces, Colours=gradient_20)
conmesh_11 = ConstructMesh(Vertices=demesh_15.Vertices, Faces=demesh_15.Faces, Colours=gradient_21)
conmesh_12 = ConstructMesh(Vertices=demesh_13.Vertices, Faces=demesh_13.Faces, Colours=gradient_16)
conmesh_13 = ConstructMesh(Vertices=demesh_14.Vertices, Faces=demesh_14.Faces, Colours=gradient_17)
conmesh_14 = ConstructMesh(Vertices=demesh_15.Vertices, Faces=demesh_15.Faces, Colours=gradient_18)
vdisex_5 = VectorDisplayEx(Point=demesh_13.Vertices, Vector=amp_5, Colour=gradient_13, Width=2)
vdisex_6 = VectorDisplayEx(Point=demesh_14.Vertices, Vector=amp_6, Colour=gradient_14, Width=2)
vdisex_7 = VectorDisplayEx(Point=demesh_15.Vertices, Vector=amp_7, Colour=gradient_15, Width=2)
conmesh_15 = ConstructMesh(Vertices=demesh_16.Vertices, Faces=demesh_16.Faces, Colours=gradient_24)
conmesh_16 = ConstructMesh(Vertices=demesh_16.Vertices, Faces=demesh_16.Faces, Colours=gradient_23)
vdisex_8 = VectorDisplayEx(Point=demesh_16.Vertices, Vector=amp_8, Colour=gradient_22, Width=2)
