# Grasshopper definition CR_VS-UMCF_J-DOE20_March(24hrs).gh (Grasshopper 1.0.8)
# plug-ins: RhinoCodePluginGH, UMCF

# ---- group: Building
brep = Brep([<brep referenced from the Rhino model> x2])

# ---- group: Vegetation
brep_2 = Brep([<brep referenced from the Rhino model> x3])

# ----
# Setup
number_slider = Slider(0.32, range=0..1)
custom_mesh_settings = SettingsCustom(
    StitchSeams=True,
    SimplePlanes=False,
    Refine=True,
    MinCount=16,
    MaxCount=400,
    AspectRatio=20,
    MaxDistance=0,
    MaxAngle=20,
    MinEdge=number_slider,
    MaxEdge=number_slider)
number_slider_2 = Slider(0, range=0..100)
number_slider_3 = Slider(8.2, range=0..100)
number_slider_4 = Slider(11, range=0..100)
number_slider_5 = Slider(4.7, range=0..100)
number_slider_6 = Slider(14, range=0..100)
number_slider_7 = Slider(3.4, range=0..100)
X = UnitX(Factor=1)
rotate = Rotate(Geometry=X, Angle=degrees(Slider(0, range=0..100)), Plane=PlaneXY(0, 0, 0))  # -> Geometry, Transform
mesh = MeshBrep(Brep=brep, Settings=custom_mesh_settings)
vegproperties = VegetationProperties(
    H=Slider(7, range=0..15),
    L=Slider(0.15, range=0..0.15),
    RsMin=Slider(275, range=0..10000),
    NEvapSides=Slider(1, range=0..1))
mesh_2 = MeshBrep(Brep=brep_2, Settings=custom_mesh_settings)
abl = ABLCondition(WindSpeed=Slider(7, range=0..10), Height=Slider(10, range=0..10), WindDirection=rotate.Geometry)
boxdomaindim = BoxDomainDimensions(
    CellSize=Slider(15, range=0..100),
    FrontAdd=Slider(0, range=0..100),
    BackAdd=Slider(0, range=0..100),
    SidesAdd=Slider(0, range=0..100),
    TopAdd=Slider(0, range=0..100),
    RefinementBoxAdd=Slider(15, range=0..100))
brick = BuildingMaterialHamstad5Brick()
mesh_3 = Mesh([<mesh referenced from the Rhino model> x3])
mesh_4 = Mesh([<mesh referenced from the Rhino model> x18])
airregion = AirRegion(ABLConditionSetting=abl, BoxDomainParameters=boxdomaindim)
vegregion = VegetationRegion(VegetationMesh=mesh_4, LAD=Slider(1.5, range=0..5), VegetationProperties=vegproperties)
solidregion = SolidRegion(SolidRegionName="Building", Mesh=mesh, Material=brick, BuildingTemperature=Slider(16, range=0..100))

path = FilePath("C:\Users\crothe3\GaTech Dropbox\Chinmay Rothe\UMCF\CR_Vegetation Siulation files\USA_GA_Atlanta-Hartsfield-Jackson.Intl.AP.722190_TMYx\USA_GA_Atlanta-Hartsfield-Jackson.Intl.AP.722190_TMYx.epw")
duration = Slider(24, range=0..24)
weather = Weather(EPWFilePath=path)
timing = TimingParameters(Weather=weather, StartDay=Slider(75, range=0..364), StartTime=Slider(0, range=0..23), Duration=duration)
simsettings = SimulationSettings(NumberOfCPUs=Slider(12, range=0..20), MaxFluidIteration=Slider(100, range=0..1000))
desetting = DeconstructSetting(Setting=timing)  # -> Entries, ListContainers
write = Button()
clear = Button()
path_2 = FilePath("C:\MetaFoam_Cases\")
item = ListItem(List=desetting.ListContainers, Index=Slider(4, range=0..10), Wrap=True)
umcf_case = UrbabMicroClimateFoamCase(
    WriteCase=write,
    ClearCase=clear,
    NewCaseName="CR_VS-UMCF_J-DOE20_March(9hrs)",
    WorkingDirectory=path_2,
    AirRegion=airregion,
    VegetationRegions=vegregion,
    SolidRegions=solidregion,
    TimingSettings=timing,
    SimulationSettings=simsettings)  # -> ModificationLogs, Case, DomainBox, RefinementBox
defilecontainer = DeconstructFileContainer(FileContainer=item)  # -> Name, FileType, Keys, Values, RawContent, TotalRawContent
panel = Panel(defilecontainer.Name)
panel_2 = Panel(defilecontainer.RawContent)
rep = ReplaceText(Text=defilecontainer.Values, Find="(", RecursiveReplace=False)
wires = BrepWireframe(Brep=umcf_case.DomainBox, Density=-1)
wires_2 = BrepWireframe(Brep=umcf_case.RefinementBox, Density=-1)
panel_3 = Panel(umcf_case.ModificationLogs)
rep_2 = ReplaceText(Text=rep, Find=")", RecursiveReplace=False)
preview = CustomPreview(Geometry=wires, Material=ColourSwatch(SwatchColor=RGB(97, 97, 97)))
preview_2 = CustomPreview(Geometry=wires_2, Material=ColourSwatch(SwatchColor=RGB(230, 230, 230)))
split = TextSplit(Text=rep_2, Separators=" ")  # disabled
caserun = CaseRun(
    Case=umcf_case.Case,
    PrepareSimulation=Button(),
    PrepareSimulationInParallel=Button(),
    RunSimulation=Button(),
    RunSimulationInParallel=Button())  # -> Case, LogFileNames, LogFileContent
item_2 = ListItem(List=split, Index=0, Wrap=True)  # -> Item, Item1, Item2; disabled
debrep = DeconstructBrep(Brep=umcf_case.DomainBox)  # -> Faces, Edges, Vertices
pt = ConstructPoint(XCoordinate=item_2.Item, YCoordinate=item_2.Item1, ZCoordinate=item_2.Item2)  # disabled
item_3 = ListItem(List=debrep.Faces, Index=Slider(4, range=0..10), Wrap=True)
panel_4 = Panel(defilecontainer.Values)
crv = Curve(item_3)
mesh_uv = MeshSurface(Surface=item_3, UCount=Slider(49, range=0..100), VCount=Slider(31, range=0..100), Overhang=True, Equalize=False)
cap = CapHoles(Brep=brep)
Z = UnitZ(Factor=Slider(2, range=0..10))
preview_3 = CustomPreview(Geometry=crv, Material=ColourSwatch(SwatchColor=RGB(0, 0, 0)))
move = Move(Geometry=mesh_uv, Motion=Z)  # -> Geometry, Transform
demesh = DeconstructMesh(Mesh=move.Geometry)  # -> Vertices, Faces, Colours, Normals
brepsinc = PointInBreps(Brep=cap, Point=demesh.Vertices, Strict=False)  # -> Inside, Index
cullv = CullVertices(Mesh=move.Geometry, Pattern=brepsinc.Inside, Shrink=True)
demesh_2 = DeconstructMesh(Mesh=cullv)  # -> Vertices, Faces, Colours, Normals
panel_5 = Panel("""T
U
w""")
probing = Probing(
    Run=Button(),
    Case=caserun.Case,
    ProbingName="probing01",
    InterpolationScheme="3",
    Fields=panel_5,
    ProbingPoints=demesh_2.Vertices)
number_slider_8 = Slider(1, range=1..14)
getprobes = GetProbes(Case=probing, ProbingName="probing01", Field="w")  # -> TimeSteps, simplify(ProbeValues)
getprobes_2 = GetProbes(Case=probing, ProbingName="probing01", Field="T")  # -> TimeSteps, simplify(ProbeValues)
getprobes_3 = GetProbes(Case=probing, ProbingName="probing01", Field="U")  # -> TimeSteps, simplify(ProbeValues)
data = Data(simplify(getprobes.ProbeValues))
branch = TreeBranch(Tree=getprobes_3.ProbeValues, Path=number_slider_8, MaintainPaths=True)
branch_2 = TreeBranch(Tree=getprobes_2.ProbeValues, Path=number_slider_8, MaintainPaths=True)
branch_3 = TreeBranch(Tree=getprobes.ProbeValues, Path=number_slider_8, MaintainPaths=True)
vec = Vector(branch)
tag = TextTag3D(Location=demesh_2.Vertices, Text=branch_2, Size=Slider(0.07, range=0..1), Justification=5)  # disabled
vlen = VectorLength(Vector=vec)
average = Average(Input=vlen)
python_3_script = Python3Script()  # -> out, a; inputs U: list
# ---------- python_3_script: Python ----------
"""Grasshopper Script"""
# requirements: matplotlib
a = "Hello Python 3 in Grasshopper!"
print(a)

import matplotlib.pyplot as plt

# Input: 'U,T,W' is a list of floats coming from Grasshopper
data = U,T,W # Ensure input_data is a list of floats

# Create a histogram
plt.hist(data, bins=10, edgecolor='black')  # Adjust the 'bins' as needed

# Add a title and labels
plt.title('Histogram of Input Data')
plt.xlabel('Value')
plt.ylabel('Frequency')

# Show the plot
plt.show()
# ---------- end python_3_script ----------
panel_6 = Panel(average)
bnd = Bounds(Numbers=vlen)
bnd_2 = Bounds(Numbers=branch_2)
bnd_3 = Bounds(Numbers=branch_3)
dom = ConstructDomain(DomainStart=Slider(0.2, range=0..10), DomainEnd=Slider(1.7, range=0..10))
dedomain = DeconstructDomain(Domain=bnd)  # -> Start, End
dedomain_2 = DeconstructDomain(Domain=bnd_2)  # -> Start, End
remap = RemapNumbers(Value=vlen, Source=bnd, Target=dom)  # -> Mapped, Clipped
dedomain_3 = DeconstructDomain(Domain=bnd_3)  # -> Start, End
gradient = Gradient(
    LowerLimit=dedomain.End,
    UpperLimit=dedomain.Start,
    Parameter=vlen,
    stops=[0: RGB(234, 38, 0), 0.25: RGB(234, 126, 0), 0.5: RGB(254, 244, 84), 0.75: RGB(173, 203, 249), 1: RGB(75, 107, 169)])
gradient_2 = Gradient(
    LowerLimit=dedomain_2.End,
    UpperLimit=dedomain_2.Start,
    Parameter=branch_2,
    stops=[0: RGB(234, 38, 0), 0.25: RGB(234, 126, 0), 0.5: RGB(254, 244, 84), 0.75: RGB(173, 203, 249), 1: RGB(75, 107, 169)])
amp = Amplitude(Vector=vec, Amplitude=remap.Mapped)
gradient_3 = Gradient(
    LowerLimit=dedomain_3.End,
    UpperLimit=dedomain_3.Start,
    Parameter=branch_3,
    stops=[0: RGB(234, 38, 0), 0.25: RGB(234, 126, 0), 0.5: RGB(254, 244, 84), 0.75: RGB(173, 203, 249), 1: RGB(75, 107, 169)])
conmesh = ConstructMesh(Vertices=demesh_2.Vertices, Faces=demesh_2.Faces, Colours=gradient_3)
conmesh_2 = ConstructMesh(Vertices=demesh_2.Vertices, Faces=demesh_2.Faces, Colours=gradient_2)
vdisex = VectorDisplayEx(Point=demesh_2.Vertices, Vector=amp, Colour=gradient, Width=2)
